vi "index.gviweb"   [G Web Development Software 22.3.0]
panel controls:
  "Exit (development only)": bool
  "Test Start": bool
  "Test Sequence": T3[]
panel indicators:
  "Total Duration (s)": f64
  "Step Status": T1[]
  "manager": error
  "ui": error
  "Program Log": string
  "dev status": string
  "Status": string
  "Initialized": bool
  "Finalized": bool
  "io": error
  "Graph": f64[][]
  "Pass": bool
types:
  "Color.gtype" = u32
  T1 = cluster{"Progress": f64, "Result": "Color.gtype"}
  T2 = cluster{"Waveform": enum{"Constant", "Sawtooth", "Sinusoid"}, "Amplitude": f64, "Frequency": f64}
  T3 = cluster{"Duration (s)": f64, "Waveform Data": T2, "Fault Probability": f64}
  "Manager State.gtype" = enum{"Idle", "Initialize", "Execute", "Finalize", "Error"}
  "Message Queue Names.gtype" = enum{"Manager", "UI", "IO"}
  "Step Data.gtype" = cluster{"Message Queue": "Message Queue Names.gtype", "Action": string}
  "Sequence.gtype" = cluster{"Manager State": "Manager State.gtype", "Steps": "Step Data.gtype"[]}
  "Manager Data.gtype" = cluster{"Current State": "Manager State.gtype", "Current Step": "Step Data.gtype", "Remaining Steps": "Step Data.gtype"[], "Remaining Sequences": "Sequence.gtype"[]}
  "Step Result.gtype" = enum{"Pass", "Fail", "Canceled"}
  "Step Status.gtype" = cluster{"Progress": f64, "Result": "Step Result.gtype", "Complete": bool}
  "Waveforms.gtype" = enum{"Constant", "Sawtooth", "Sinusoid"}
  "Waveform Data.gtype" = cluster{"Waveform": "Waveforms.gtype", "Amplitude": f64, "Frequency": f64}
  "Test Step Data.gtype" = cluster{"Duration (s)": f64, "Waveform Data": "Waveform Data.gtype", "Fault Probability": f64}
  "IO Data.gtype" = cluster{"Waveform": "Waveforms.gtype", "Duration (s)": f64, "Start Time": timestamp, "Time Factor": f64, "Adjusted Amplitude": f64, "New Wave": bool, "Wave Active": bool, "Fault start time": f64}
uses:
  WebApp::support::Message Queue::Create All Message Queues.gvi
  WebApp::support::Message Queue::Dequeue Message.gvi
  WebApp::support::Message Queue::Enqueue Message (Single).gvi
  WebApp::UI messages::Append Log Text.gviweb
  WebApp::program sequences::Handle Next Sequence.gviweb
  WebApp::program sequences::Handle Next Step.gviweb
  NI::G Core::Error::Build Error Cluster.gvi
  WebApp::UI messages::Send Sequence Complete UI Updates.gviweb
  WebApp::UI messages::Update Program Status.gviweb
  WebApp::support::Error Handler - Message Handling Loop.gvi
  WebApp::support::Error Handler - Event Handling Loop.gvi
  WebApp::Prep Step Staus for Display.gviweb
  WebApp::Calculate Test Duration.gviweb
  WebApp::Validate Test Sequence.gviweb
  WebApp::Report Step Complete.gviweb
  WebApp::Receive IO Data.gviweb
  WebApp::Get Result Color.gviweb
  WebApp::globals.gviweb
  WebApp::IO::Handle Next Waveform.gviweb
  WebApp::IO::Generate Waveform.gviweb
  WebApp::IO::Handle Hardware IO.gviweb
  WebApp::debug::Check Test Sequence Complete.gviweb
diagram:
  # #debug
  Property Node(instance in=reference to "dev status", "Value"="") -> (error out=w1)
  w2 = bool FALSE  # Stop Event
  Create User Event[EventName="Stop Event"](error in=w1, user event data type=w2) -> (error out=w3, user event out=w4)
  # Make list of messages for easy screening
  w5 = [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]  # Instructions
  for {
    w6 = each element of w5
    Property Node(instance in=w6) -> ("Init Info:Start Message"=w8)
    append w8 to w7
  }
  # Idle
  #
  # Start Pressed
  #
  # Initializaing
  # 	>> To IO ---Initialize
  # 	Waiting on UI
  # 	>> To UI ---Initialize
  # 	Waiting on IO
  # Executing
  # 	>> To IO ---Execute
  # 	Waiting on IO
  # Finalizing
  # 	>> To IO ---Finalize
  # 	Waiting on IO
  # 	>> To UI ---Finalize
  # 	Waiting on UI
  # Completed
  Build Array("Manager", "UI", "IO") -> w9
  Array Size(array=w9) -> (size(s)=w10)
  call "Create All Message Queues.gvi"(Loop Count=w10, error in=w3) -> (Message Queues=w11, error out=w12)
  Array Index(array=w11) -> (out0[_]=w13, out1[_]=w14, out2[_]=w15)
  s1 = uninitialised  # shift register
  while {
    call "Dequeue Message.gvi"(message queue in=w13, error in=w12) -> (message queue out=w16, message=w17, message data=w18, error out=w19)
    # Manager Loop
    # w4: Stop Event
    case (w17) ignore case {  # Message Cases
      frame "SW Init" {
        w20 = w19
        w21 = default
        w22 = "Manager Data.gtype" {all zero or empty}
      }
      frame "Test Sequence Change" {
        Array Index(array=w11) -> (out0["UI"]=w23)
        call "Enqueue Message (Single).gvi"(message queue in=w23, message="Handle Test Change", message data=w18, error in=w19) -> (error out=w20)
        w21 = default
        w22 = s1
      }
      frame "Error" {
        # #CodeRecommended - Consider creating a system for logging errors in some way. These errors are for notification purposes only. Handling of specific errors should be performed in the message frames that generated the error.
        Variant To Data(error in (no error)=w19, type=no error, variant=w18) -> (data=w24, error out=w20)
        # #CodeRecommended - If you ever change the name of this "Error" message, you'll need to update the name in the Check Loop Error.vi as well.
        $manager <- w24
        w21 = default
        w22 = s1
      }
      frame "Exit Pressed" {
        # #development
        s2 = w19  # shift register
        for {
          w25 = each element of w11
          call "Enqueue Message (Single).gvi"(message queue in=w25, message="Exit", error in=s2) -> (error out=w26)
          next s2 = w26
        }
        Merge Errors(s2) -> (error out=w20)
        w21 = default
        w22 = s1
      }
      frame "Exit" {
        Generate User Event(event data=TRUE, user event=w4) -> (error out=w27)
        Release Queue(queue=w16) -> (error out=w28)
        Merge Errors(w28, w27) -> (error out=w20)
        w21 = TRUE
        w22 = s1
      }
      frame Default {
        Search 1D Array(1D array=w7, element=w17) -> (index of element=w29)
        case (w29) {
          frame Default {
            Property Node(instance in=s1) -> ("Current State"=w30, instance out=w31)
            Array Index(array=w5) -> (out0[w29]=w32)
            Property Node(instance in=w32) -> ("Init Info:Valid Starts"=w33, instance out=w34)
            Search 1D Array(1D array=w33, element=w30) -> (index of element=w35)
            # Message in sequence start list -> ensure in valid start state
            case (w35) {
              frame Default {
                call "Append Log Text.gviweb"(Input=w11, resulting string="******************\nStart\n******************", error out=w19) -> (Output_2=w36)
                Property Node(instance in=w34) -> ("Sequences"=w37)
                # In valid state for recieved message -> react
                call "Handle Next Sequence.gviweb"(manager data in=w31, Sequences=w37, error in=w36, Message Queues=w11) -> (manager data out=w38, Sequence Steps=w39, Sequences Empty=w40, error out=w41)
                case (w40) {
                  frame True {
                    w42 = "-------------------------------------\nSequences Empty\n-------------------------------------"
                    # #verify
                    call "Append Log Text.gviweb"(Input=w11, resulting string=w42, error out=w41) -> (Output_2=w20)
                    w22 = w38
                  }
                  frame False {
                    call "Handle Next Step.gviweb"(message queues=w11, manager data in=w38, Sequence Steps=w39, Input=w41, message data=w18) -> (manager data out=w22, Output=w20)
                  }
                }
              }
              frame -1 {
                w43 = """-------------------------------------
Received inavalid message for current status

Invalid Message: %s

State: %s
Currently waiting on: %s
-------------------------------------"""
                Property Node(instance in=w31) -> ("Current State"=w44, "Current Step:Message Queue"=w45)
                Format Into String(formatString=w43, errIn=w19, w44, w45, w17) -> (outString=w46, errOut=w47)
                call "Append Log Text.gviweb"(Input=w11, resulting string=w46, error out=w47) -> (Output_2=w20)
                w22 = w31
              }
            }
          }
          frame -1 {
            # Message missing from sequence start list
            w48 = "The invalid message string \"%s\" was received in the Message Handling Loop."
            # Message undefined
            Format Into String(formatString=w48, w17) -> w49
            call "Build Error Cluster.gvi"(code=1, description=w49, error in=w19) -> (error out=w20)
            w22 = s1
          }
        }
        w21 = default
      }
      frame "Step Complete" {
        Property Node(instance in=s1) -> ("Current Step"=w50)
        Variant To Data(error in (no error)=w19, type=w50, variant=w18) -> (data=w51, error out=w52)
        Is Equal[ComparisonMode=CompareAggregates](x=w50, y=w51) -> w53
        case (w53) {
          frame False, Default {
            w20 = w52
            w22 = s1
          }
          frame True {
            Property Node(instance in=s1) -> ("Remaining Steps"=w54, instance out=w55)
            Array Size(array=w54) -> (size(s)=w56)
            Property Node(instance in=w50) -> ("Message Queue"=w57, "Action"=w58)
            Format Into String(formatString="Completed %s %s", errIn=w52, w57, w58) -> (outString=w59, errOut=w60)
            call "Append Log Text.gviweb"(Input=w11, resulting string=w59, error out=w60) -> (Output_2=w61)
            case (w56) {
              frame Default {
                call "Handle Next Step.gviweb"(message queues=w11, manager data in=w55, Sequence Steps=w54, Input=w61) -> (manager data out=w22, Output=w20)
              }
              frame 0 {
                Property Node(instance in=w55) -> ("Remaining Sequences"=w62, "Current State"=w63, instance out=w64)
                call "Send Sequence Complete UI Updates.gviweb"(Current State=w63, Input=w11, Error In=w61) -> (Error out=w65)
                call "Handle Next Sequence.gviweb"(manager data in=w64, Sequences=w62, error in=w65, Message Queues=w11) -> (manager data out=w66, Sequence Steps=w67, Sequences Empty=w68, error out=w69)
                case (w68) {
                  frame False, Default {
                    Property Node(instance in=w66) -> ("Current State"=w70, instance out=w71)
                    Format Into String(formatString="%s", errIn=w69, w70) -> (outString=w72, errOut=w73)
                    call "Update Program Status.gviweb"(resulting string=w72, Message Queues=w11, Input=w73) -> (error out=w74)
                    call "Handle Next Step.gviweb"(message queues=w11, manager data in=w71, Sequence Steps=w67, Input=w74) -> (manager data out=w22, Output=w20)
                  }
                  frame True {
                    # Program sequence complete
                    call "Update Program Status.gviweb"(resulting string="Complete", Message Queues=w11, Input=w69) -> (error out=w75)
                    call "Append Log Text.gviweb"(Input=w11, resulting string="******************\nComplete\n******************", error out=w75) -> (Output_2=w20)
                    w22 = w66
                  }
                }
              }
            }
          }
        }
        w21 = default
      }
    }
    call "Error Handler - Message Handling Loop.gvi"(message queue in=w16, error in=w20) -> (dup error in=w76)
    next s1 = w22
    stop if w21
  }
  # #todo
  # create separate program instruction case
  # error handling - display in status log
  # create/ configure simulation cases/ flags
  # clean up
  # 	save all text log messages in same place
  # handle error from hardware during initialize or execute
  # 	be able to clear error
  #
  #
  #
  # #additional functionality
  # ---------------------------------
  # add finalize commands
  # 	log data
  # 		with test meta data/ description
  # 	log results
  # cancel
  # abort
  # hardware fault button
  # 	just poll in UI loop?
  # -------------------------------------------------------
  # cancel
  # abort
  # Display test history/ data
  # Pause
  # select between historical data
  # historical analysis/ comparison
  # Splining/ smooth transitions between waveforms
  # unit tests
  # check for empty test sequence
  # force sawtooth to return to 0 before waveform transition?
  Register For Events("Stop Event"=w4) -> (event registration refnum out=w77)
  # This is the Queued Message Handler design pattern. The Event Handling Loop generates messages based on user interface actions. The Message Handling Loop processes messages generated by the Event Handling Loop, or by other messages.  The messages are string values, so new messages can be added easily to the Message Cases case structure in the Message Handling Loop.  Each message cluster can also provide an optional value for Message Data, which is a variant that can be converted to whatever message-specific data is required.
  s3 = w77  # shift register
  while {
    event (dynamic events = s3) {
      on "Test Start" Value changed {
        # #CodeNeeded - Send the appropriate message for this user interface event.
        call "Enqueue Message (Single).gvi"(message queue in=w13, message="Start") -> (message queue out=w80, error out=w79)
        w78 = default
      }
      on "Exit (development only)" Value changed {
        call "Enqueue Message (Single).gvi"(priority message=TRUE, message queue in=w13, message="Exit Pressed") -> (message queue out=w80, error out=w79)
        w78 = default
      }
      on dynamic event 0 {
        # The Message Handling Loop processed an "Exit" message, which fired this event to stop the Event Handling Loop.
        w78 = TRUE
        w79 = default
        w80 = w13
      }
      on "Test Sequence" Value changed {
        Event Data() -> ("New Value"=w81)
        To Variant(anything=w81) -> w82
        call "Enqueue Message (Single).gvi"(message queue in=w13, message="Test Sequence Change", message data=w82) -> (message queue out=w80, error out=w79)
        w78 = default
      }
    }
    call "Error Handler - Event Handling Loop.gvi"(message queue in=w80, error in=w79) -> (dup error in=w83)
    stop if w78
  }
  Unregister For Events(error in=w83, event registration refnum=s3) -> (error out=w84)
  Merge Errors(w84, w76) -> (error out=w85)
  Destroy User Event(error in=w85, user event=w4)
  Obtain Queue(element data type=f64[] [], name="output data") -> (queue out=w86)
  s4 = uninitialised  # shift register
  s5 = uninitialised  # shift register
  s6 = uninitialised  # shift register
  s7 = uninitialised  # shift register
  s8 = uninitialised  # shift register
  s9 = uninitialised  # shift register
  while {
    call "Dequeue Message.gvi"(message queue in=w14, timeout in milliseconds=s5, error in=w12) -> (timed out?=w87, message queue out=w88, message=w89, message data=w90, error out=w91)
    # UI Update Loop
    case (w89) ignore case {  # Message Cases
      frame "SW Init" {
        Property Node(instance in=reference to "Pass", "Value"=FALSE)
        Property Node(instance in=reference to "Finalized", "Value"=FALSE)
        Property Node(instance in=reference to "Test Sequence", "Disabled"=FALSE)
        Property Node(instance in=reference to "ui", "Value"=no error, error in=w91) -> (error out=w100, instance out=w101)
        Property Node(instance in=reference to "Initialized", "Value"=FALSE, error in=w91) -> (error out=w102, instance out=w103)
        Property Node(instance in=reference to "Status", "Value"="Idle", error in=w91) -> (error out=w104, instance out=w105)
        Property Node(instance in=reference to "Program Log", "Value"="", error in=w91) -> (error out=w106, instance out=w107)
        Build Array(w101, w103, w105, w107) -> w108
        Merge Errors(w100, w102, w104, w106) -> (error out=w109)
        s10 = w109  # shift register
        for {
          w110 = each element of w108
          Close Reference(error in=s10, reference=w110) -> (error out=w111)
          next s10 = w111
        }
        Array Size(array=[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]) -> (size(s)=w98)
        Initialize Array(element="Step Status.gtype" {all zero or empty}, size=w98) -> w97
        call "Prep Step Staus for Display.gviweb"(Steps status out=w97) -> (Step Status=w112)
        Property Node(instance in=reference to "Step Status", "Value"=w112)
        call "Calculate Test Duration.gviweb"(Test Sequences=[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]) -> (Total Duration (s)=w113)
        Property Node(instance in=reference to "Total Duration (s)", "Value"=w113)
        w92 = s10
        w93 = default
        w94 = ""
        w95 = -1
        w96 = f64[][] []
        w99 = 0
      }
      frame "Handle Test Change" {
        Variant To Data(error in (no error)=w91, type="Test Step Data.gtype"[] [], variant=w90) -> (data=w114, error out=w115)
        Array Size(array=w114) -> (size(s)=w98)
        call "Calculate Test Duration.gviweb"(Test Sequences=w114) -> (Total Duration (s)=w116)
        $"Total Duration (s)" <- w116
        call "Validate Test Sequence.gviweb"(Input=reference to "Test Sequence", UI Queue=w88, data=w114, error in=w115) -> (Error out=w92)
        w93 = default
        w94 = s4
        w95 = s5
        w96 = s6
        w97 = s7
        w99 = s9
      }
      frame "Execute" {
        # start polling to process data from IO loop
        call "Report Step Complete.gviweb"(Manager Queue=w13, This Queue Name="UI", Step Name=w89, Input_3=w91) -> (Output_2=w92)
        w93 = default
        w94 = s4
        w95 = 0
        w96 = s6
        w97 = s7
        w98 = s8
        w99 = s9
      }
      frame "Update Status" {
        Variant To Data(error in (no error)=w91, type=string "", variant=w90) -> (data=w117, error out=w92)
        Format Into String(formatString="%s\n%s", s4, w117) -> w94
        $"Program Log" <- w94
        w93 = default
        w95 = s5
        w96 = s6
        w97 = s7
        w98 = s8
        w99 = s9
      }
      frame "Update Program Status" {
        Variant To Data(error in (no error)=w91, type=w89, variant=w90) -> (data=w118, error out=w92)
        $Status <- w118
        w93 = default
        w94 = s4
        w95 = s5
        w96 = s6
        w97 = s7
        w98 = s8
        w99 = s9
      }
      frame "Initialize Complete" {
        $Initialized <- TRUE
        w92 = w91
        w93 = default
        w94 = s4
        w95 = s5
        w96 = s6
        w97 = s7
        w98 = s8
        w99 = s9
      }
      frame "Initialize" {
        Property Node(instance in=reference to "Test Sequence", "Disabled"=TRUE)
        # Enure at least 1 step is present
        Max And Min(x=s8, y=1) -> (max(x,y)=w119: i32)
        Initialize Array(element="Step Status.gtype" {all zero or empty}, size=w119) -> w97
        call "Report Step Complete.gviweb"(Manager Queue=w13, This Queue Name="UI", Step Name=w89, Input_3=w91) -> (Output_2=w92)
        w93 = default
        w94 = s4
        w95 = s5
        w96 = f64[][] []
        w98 = s8
        w99 = 0
      }
      frame "Execute Complete" {
        call "Receive IO Data.gviweb"(Test data in=s6, Steps status in=s7, Step Index in=s9, error in=w91, IO Data Queue=w86) -> (Test data out=w96, Steps status out=w97, Step Index out=w99, error out=w120, Test Data for Graph=w121)
        # Handle any data remaining in queue
        call "Prep Step Staus for Display.gviweb"(Steps status out=w97) -> (Step Status=w122)
        Property Node(instance in=reference to "Step Status", "Value"=w122, error in=w120) -> (error out=w123)
        Property Node(instance in=reference to "Graph", "Value"=w121, error in=w123) -> (error out=w92)
        w93 = default
        w94 = s4
        w95 = s5
        w98 = s8
      }
      frame "Finalize" {
        s11 = "Pass"  # shift register
        for {
          w124 = each element of s7
          Property Node(instance in=w124) -> ("Result"=w125)
          case (s11) {
            frame "Pass", Default {
              w126 = w125
            }
            frame "Fail" {
              case (w125) {
                frame Default {
                  w126 = w125
                }
                frame "Pass" {
                  w126 = s11
                }
              }
            }
            frame "Canceled" {
              w126 = s11
            }
          }
          next s11 = w126
        }
        call "Get Result Color.gviweb"(Input=s11) -> (Output=w127)
        Property Node(instance in=reference to "Pass", "TrueColor"=w127)
        # stop polling
        $Pass <- TRUE
        Property Node(instance in=reference to "Test Sequence", "Disabled"=TRUE)
        call "Report Step Complete.gviweb"(Manager Queue=w13, This Queue Name="UI", Step Name=w89, Input_3=w91) -> (Output_2=w92)
        w93 = default
        w94 = s4
        w95 = -1
        w96 = s6
        w97 = s7
        w98 = s8
        w99 = s9
      }
      frame "Finalize Complete" {
        $Finalized <- TRUE
        Property Node(instance in=reference to "Test Sequence", "Disabled"=FALSE)
        w92 = w91
        w93 = default
        w94 = s4
        w95 = s5
        w96 = s6
        w97 = s7
        w98 = s8
        w99 = s9
      }
      frame "Error" {
        Variant To Data(error in (no error)=w91, type=no error, variant=w90) -> (data=w128, error out=w92)
        # #CodeRecommended - If you ever change the name of this "Error" message, you'll need to update the name in the Check Loop Error.vi as well.
        $ui <- w128
        w93 = default
        w94 = s4
        w95 = s5
        w96 = s6
        w97 = s7
        w98 = s8
        w99 = s9
      }
      frame "---Copy This Frame---" {
        Merge Errors(w91) -> (error out=w92)
        w93 = default
        w94 = s4
        w95 = s5
        w96 = s6
        w97 = s7
        w98 = s8
        w99 = s9
      }
      frame "Exit" {
        Release Queue(queue=w88) -> (error out=w129)
        Release Queue(queue=w86) -> (error out=w130)
        Merge Errors(w91, w129, w130) -> (error out=w92)
        w93 = TRUE
        w94 = s4
        w95 = s5
        w96 = s6
        w97 = s7
        w98 = s8
        w99 = s9
      }
      frame Default {
        case (w87) {
          frame True {
            Wait(time to wait=500)
            call "Receive IO Data.gviweb"(Test data in=s6, Steps status in=s7, Step Index in=s9, error in=w91, IO Data Queue=w86) -> (Test data out=w96, Steps status out=w97, Step Index out=w99, error out=w92, Test Data for Graph=w131)
            $Graph <- w131
            call "Prep Step Staus for Display.gviweb"(Steps status out=w97) -> (Step Status=w132)
            $"Step Status" <- w132
          }
          frame False {
            w133 = "The invalid message string \"%s\" was received in the Message Handling Loop."
            Format Into String(formatString=w133, w89) -> w134
            call "Build Error Cluster.gvi"(code=1, description=w134, error in=w91) -> (error out=w92)
            w96 = s6
            w97 = s7
            w99 = s9
          }
        }
        w93 = default
        w94 = s4
        w95 = s5
        w98 = s8
      }
    }
    call "Error Handler - Message Handling Loop.gvi"(message queue in=w88, error in=w92) -> (dup error in=w135)
    next s4 = w94
    next s5 = w95
    next s6 = w96
    next s7 = w97
    next s8 = w98
    next s9 = w99
    stop if w93
  }
  s12 = uninitialised  # shift register
  s13 = uninitialised  # shift register
  while {
    call "Dequeue Message.gvi"(message queue in=w15, timeout in milliseconds=0, error in=w12) -> (timed out?=w136, message queue out=w137, message=w138, message data=w139, error out=w140)
    # UI Update Loop
    case (w138) ignore case {  # Message Cases
      frame "SW Init" {
        Property Node(instance in=reference to "io", "Value"=no error, error in=w140) -> (error out=w141)
        w142 = default
        w143 = s12
        w144 = "IO Data.gtype" {all zero or empty}
      }
      frame "Initialize" {
        disable {
          frame Disabled {
            # #Integrate_Hardware
            # Hardware uninitialization goes here
            w145 = w140
          }
          frame Enabled {
            call "globals.gviweb"() -> (Globals=w146)
            Property Node(instance in=w146) -> ("Hardware Initialize Duration (s)"=w147)
            # #debug
            Multiply(w147, 1000) -> w148
            Wait(time to wait=w148)
            w145 = w140
          }
        }
        call "Report Step Complete.gviweb"(Manager Queue=w13, This Queue Name="IO", Step Name=w138, Input_3=w145) -> (Output_2=w141)
        w142 = default
        w143 = s12
        w144 = s13
      }
      frame "Finalize" {
        disable {
          frame Disabled {
            # #Integrate_Hardware
            # Hardware uninitialization goes here
            w149 = w140
          }
          frame Enabled {
            call "globals.gviweb"() -> (Globals=w150)
            Property Node(instance in=w150) -> ("Hardware Finalize Duration (s)"=w151)
            # #debug
            Multiply(w151, 1000) -> w152
            Wait(time to wait=w152)
            w149 = w140
          }
        }
        call "Report Step Complete.gviweb"(Manager Queue=w13, This Queue Name="IO", Step Name=w138, Input_3=w149) -> (Output_2=w141)
        w142 = default
        w143 = s12
        w144 = s13
      }
      frame "Execute" {
        # #todo move some of this functionality to initialization and check if test sequence is empty
        # report empty back to manager
        call "Handle Next Waveform.gviweb"(Test Sequence in=$"Test Sequence", IO Data In=s13) -> (Test Sequence out=w143, IO Data out=w144)
        w141 = w140
        w142 = default
      }
      frame "Error" {
        Variant To Data(error in (no error)=w140, type=no error, variant=w139) -> (data=w153, error out=w141)
        # #CodeRecommended - If you ever change the name of this "Error" message, you'll need to update the name in the Check Loop Error.vi as well.
        $io <- w153
        w142 = default
        w143 = s12
        w144 = s13
      }
      frame "---Copy This Frame---" {
        Merge Errors(w140) -> (error out=w141)
        w142 = default
        w143 = s12
        w144 = s13
      }
      frame "Exit" {
        Release Queue(queue=w137) -> (error out=w154)
        Merge Errors(w140, w154) -> (error out=w141)
        w142 = TRUE
        w143 = s12
        w144 = s13
      }
      frame Default {
        case (w136) {
          frame True {
            Property Node(instance in=s13) -> ("Wave Active"=w155, instance out=w156)
            # No message -> handle output
            case (w155) {
              frame False, Default {
                w144 = w156
                w141 = w140
                w143 = s12
              }
              frame True {
                Property Node(instance in=w156) -> ("New Wave"=w157, instance out=w158)
                case (w157) {
                  frame False, Default {
                    w159 = w158
                  }
                  frame True {
                    Get Current Time() -> (current time=w160)
                    # only save init timestamp at wave start
                    Property Node(instance in=w158, "Start Time"=w160, "New Wave"=FALSE) -> (instance out=w159)
                  }
                }
                call "Generate Waveform.gviweb"(IO Data=w159) -> (Time Elapsed=w161, IO data out=w162, Wave Value=w163, Fraction Complete=w164)
                call "Handle Hardware IO.gviweb"(IO data in=w162, Hardware output=w163, Time Elapsed=w161) -> (IO data out=w165, Hardware input=w166)
                call "Check Test Sequence Complete.gviweb"(This Queue Name="IO", Test Sequence in=s12, IO data in=w165, Fraction Complete=w164, Manager Queue=w13) -> (Test Sequence out=w143, IO data out=w144, Fraction Complete (includes messages)=w167)
                Build Array(w167, w163, w166) -> w168
                Enqueue Element(element=w168, error in=w140, queue=w86) -> (error out=w141)
              }
            }
          }
          frame False {
            # Received message
            w169 = "The invalid message string \"%s\" was received in the Message Handling Loop."
            Format Into String(formatString=w169, w138) -> w170
            call "Build Error Cluster.gvi"(code=1, description=w170, error in=w140) -> (error out=w141)
            w144 = s13
            w143 = s12
          }
        }
        w142 = default
      }
    }
    call "Error Handler - Message Handling Loop.gvi"(message queue in=w137, error in=w141) -> (dup error in=w171)
    Wait(time to wait=50)
    next s12 = w143
    next s13 = w144
    stop if w142
  }
  Property Node(instance in=reference to "Test Sequence", "Value"=[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])
